# Grasshopper definition connectors.gh (Grasshopper 1.0.7)
# plug-ins: Kangaroo2 Components

connection_length = Slider(10, range=1..10)
# PARAMETRIC HOUSE
# Ghfile.com
curve = Curve([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])
flip_curve = FlipCurve(Curve=curve)  # -> Curve, Flag
evaluate_length = EvaluateLength(Curve=curve, Length=connection_length, Normalized=invert(True))  # -> Point, Tangent, Parameter
evaluate_length_2 = EvaluateLength(Curve=flip_curve.Curve, Length=connection_length, Normalized=invert(True))  # -> Point, Tangent, Parameter
end_points = EndPoints(Curve=curve)  # -> Start, End
extend = Slider(3.35, range=0..10)
shatter = Shatter(Curve=flip_curve.Curve, Parameters=evaluate_length_2.Parameter)
line = Line(StartPoint=end_points.Start, EndPoint=evaluate_length.Point)
line_2 = Line(StartPoint=end_points.End, EndPoint=evaluate_length_2.Point)
line_3 = Line(StartPoint=evaluate_length.Point, EndPoint=evaluate_length_2.Point)
list_item = ListItem(List=shatter, Index=0, Wrap=True)  # -> Item, Item1
radius_1 = Slider(0.91, range=0.1..3)
curve_2 = Curve(flatten([line, line_2]))
extend_curve = ExtendCurve(Curve=line_3, Type=0, Start=extend, End=extend)
end_points_2 = EndPoints(Curve=curve_2)  # -> Start, End
pipe = Pipe(Curve=extend_curve, Radius=radius_1, Caps=1)  # -> flatten(Pipe)
point = Point(end_points_2.Start)
cull_duplicates = CullDuplicates(Points=point, Tolerance=0.1, CullMode=1)  # -> Points, Indices, Valence
mesh_sphere_ex = MeshSphereEx(Base=cull_duplicates.Points, Radius="0.01", Count=5)
mesh_inclusion = MeshInclusion(Mesh=graft(mesh_sphere_ex), Point=point, Strict=False)
dispatch = Dispatch(List=curve_2, DispatchPattern=mesh_inclusion)  # -> ListA, ListB
radius_1_2 = Slider(1.56, range=0.1..3)
curve_3 = Curve(dispatch.ListA)
mp = MultiPipe(Curves=curve_3, NodeSize=radius_1_2, EndOffset=1, StrutSize=1, Segment=0, KinkAngle=0.6, CubeFit=0, Caps="2")  # -> simplify(Pipe)
final = BooleanToggle(False)
brep = Brep(graft(mp))
cull_pattern = CullPattern(List=pipe, CullPattern=invert(final))
cull_pattern_2 = CullPattern(List=pipe, CullPattern=final)
cull_pattern_3 = CullPattern(List=brep, CullPattern=invert(final))
cull_pattern_4 = CullPattern(List=brep, CullPattern=final)
solid_difference = SolidDifference(BrepsA=cull_pattern_4, BrepsB=cull_pattern_2)
custom_preview = CustomPreview(Geometry=cull_pattern, Material=ColourSwatch(SwatchColor=RGB(255, 255, 0)))
brep_2 = Brep(solid_difference)
custom_preview_2 = CustomPreview(Geometry=[cull_pattern_3, brep_2], Material=ColourSwatch(SwatchColor=RGBA(0, 0, 0, 75)))
brep_3 = Brep(pipe)
